# Dynamo graph GetVolumes.dyn (Dynamo 1.3.4.6666)

string = StringInput("C:\Users\Marat\Documents\Thesis\BackendServer\InnerSurface.obj")
categories = Categories("Rooms")
all_elements_of_category = ElementsOfCategory(categories)
solids = Element.Solids(all_elements_of_category)
flatten = Flatten(solids)
byUnion = Solid.ByUnion(flatten)
byGeometry = Autodesk.Dynamo.MeshToolkit.Mesh.ByGeometry(byUnion)
exportMeshes = Autodesk.Dynamo.MeshToolkit.Mesh.ExportMeshes(string, byGeometry)
watch = Watch(flatten)
